# Grasshopper definition plan_to_abb_track.ghx (Grasshopper 1.0.7)
# plug-ins: karambaGH

# ---- group: end effector definition from flange
robot_dof = Panel("7")
point = Point("0,0,0.3705")

# ----
rhino_doc_dir = RhinoDocDir()  # -> rhino_doc_dir
# ---------- rhino_doc_dir: Python ----------
import scriptcontext as sc
from os import path

rhino_doc_dir = path.abspath(path.dirname(sc.doc.Path))
# ---------- end rhino_doc_dir ----------
text = Text(rhino_doc_dir)
ghpython_script = GhPythonScript(x=text, y="1_exp_tets_regression-z__solution_20-12-17_11-57-43.json")  # -> out, a
# ---------- ghpython_script: Python ----------
import os

a = os.path.join(x, '..', '..', 
    'tests', 'results', y)
# ---------- end ghpython_script ----------
panel = Panel(ghpython_script.a)
ghpython_script_2 = GhPythonScript(result_file_path=ghpython_script.a, ee_link_name="eef_tcp_frame", scale="1")  # -> out, paths, ee_paths, elements, tags, grasps, axispts_from_index, radius, goal_poses
# ---------- ghpython_script_2: Python ----------
import rhinoscriptsyntax as rs
import Rhino.Geometry.Plane as Plane
import Rhino.Geometry.Point3d as Point3d
import Rhino.Geometry.Vector3d as Vector3d
import Rhino.Geometry.Quaternion as Quat
import Rhino.Geometry.Line as Line
import Rhino.Geometry.Transform as Transform
import Grasshopper.DataTree as DataTree # Add, AddRange(list, GHPath(i, j))
import Grasshopper.Kernel.Data.GH_Path as GHPath
import System

from ghpythonlib.treehelpers import list_to_tree, tree_to_list

import json
from compas.geometry import Frame
from compas.geometry import scale_points
from compas_ghpython import draw_pipes, draw_frame
from itertools import islice

######################################

def pose_from_frame(frame, scale=1.0):
    """Returns a PyBullet pose from a frame.
    Parameters
    ----------
    frame : :class:`compas.geometry.Frame`
    Returns
    -------
    point, quaternion : tuple
    """
    return ([v*scale for v in frame.point], frame.quaternion.xyzw)


def frame_from_pose(pose, scale=1.0):
    """Returns a frame from a PyBullet pose.
    Parameters
    ----------
    point, quaternion : tuple
    Returns
    -------
    :class:`compas.geometry.Frame`
    """
    point, (x, y, z, w) = pose
    return Frame.from_quaternion([w, x, y, z], point=[v*scale for v in point])

#########################################

with open(result_file_path) as json_file:
    data = json.load(json_file)

print('file_name: {}'.format(data['problem']))
try:
    print('write_time: {}'.format(data['write_time']))
except:
    pass

paths = DataTree[System.Double]()
ee_paths = DataTree[Plane]()
elements = DataTree[System.Int32]()
tags = DataTree[System.String]()
grasps = DataTree[Plane]()
for seq_id, e_trajs in enumerate(data['plan']):
    if seq_id == 0:
        del e_trajs[0]
    for sp_id, traj in enumerate(e_trajs):
        path = traj['path']
        epath = traj['link_path'][ee_link_name]
        for t_id, (conf, epose) in enumerate(zip(path, epath)):
            conf = [float(v) for v in conf]
            paths.AddRange(conf, GHPath(seq_id, sp_id, t_id))
            ee_paths.Add(draw_frame(frame_from_pose(epose, scale)), GHPath(seq_id, sp_id, t_id))
            
        if traj['element'] is not None: 
            elements.Add(traj['element'], GHPath(seq_id, sp_id))
        else:
            elements.Add(-1000, GHPath(seq_id, sp_id))
        tags.Add(traj['tag'], GHPath(seq_id, sp_id))
        
        for attach_data in traj['attachments']:
            g_frame = frame_from_pose(attach_data['grasp_pose'], scale=scale)
            grasps.Add(draw_frame(g_frame), GHPath(seq_id, sp_id))
            
            
axispts_from_index = DataTree[Point3d]()
radius = DataTree[System.Double]()
goal_poses = DataTree[Plane]()
for e_id, edata in data['element_from_index'].items():
    radius.Add(edata['radius']*scale, GHPath(int(e_id)))
    
    goal_frame = frame_from_pose(edata['goal_pose']['value'], scale=scale)
    goal_poses.Add(draw_frame(goal_frame), GHPath(int(e_id)))
    
    scaled_pts = scale_points(edata['axis_endpoints'], scale)
    for i in range(2):
        axispts_from_index.Add(Point3d(*scaled_pts[i]), GHPath(int(e_id)))
# ---------- end ghpython_script_2 ----------
rhino_doc_dir_2 = RhinoDocDir()  # -> rhino_doc_dir; disabled; same code as rhino_doc_dir
ghpython_script_3 = GhPythonScript(result_file_path=ghpython_script.a, scale="1")  # -> out, elements; disabled
# ---------- ghpython_script_3: Python ----------
import rhinoscriptsyntax as rs
import Rhino.Geometry.Plane as Plane
import Rhino.Geometry.Point3d as Point3d
import Rhino.Geometry.Vector3d as Vector3d
import Rhino.Geometry.Quaternion as Quat
import Rhino.Geometry.Line as Line
import Rhino.Geometry.Transform as Transform
import Grasshopper.DataTree as DataTree # Add, AddRange(list, GHPath(i, j))
import Grasshopper.Kernel.Data.GH_Path as GHPath
import System

from ghpythonlib.treehelpers import list_to_tree, tree_to_list

import json
from compas.geometry import Frame
from compas.geometry import scale_points
from compas_ghpython import draw_pipes, draw_frame
from itertools import islice

######################################

def pose_from_frame(frame, scale=1.0):
    """Returns a PyBullet pose from a frame.
    Parameters
    ----------
    frame : :class:`compas.geometry.Frame`
    Returns
    -------
    point, quaternion : tuple
    """
    return ([v*scale for v in frame.point], frame.quaternion.xyzw)


def frame_from_pose(pose, scale=1.0):
    """Returns a frame from a PyBullet pose.
    Parameters
    ----------
    point, quaternion : tuple
    Returns
    -------
    :class:`compas.geometry.Frame`
    """
    point, (x, y, z, w) = pose
    return Frame.from_quaternion([w, x, y, z], point=[v*scale for v in point])

#########################################

with open(result_file_path) as json_file:
    data = json.load(json_file)

print('file_name: {}'.format(data['problem']))
try:
    print('write_time: {}'.format(data['write_time']))
except:
    pass

paths = DataTree[System.Double]()
ee_paths = DataTree[Plane]()
elements = DataTree[System.Int32]()
tags = DataTree[System.String]()
grasps = DataTree[Plane]()
for seq_id, e_trajs in enumerate(data['plan']):
    if seq_id == 0:
        del e_trajs[0]
    for sp_id, traj in enumerate(e_trajs):
        if traj['element'] is not None: 
            elements.Add(traj['element'], GHPath(seq_id, sp_id))
        else:
            elements.Add(-1000, GHPath(seq_id, sp_id))
# ---------- end ghpython_script_3 ----------
panel_2 = Panel("reciprocal_sphere_quarter_regression-z__solution_20-12-07_11-25-49.json")  # disabled
panel_3 = Panel("reciprocal_sphere_quarter_conmech_model.json")  # disabled
panel_4 = Panel("d:\code_ws\pb_ws\coop_assembly\tests")  # disabled
ghpython_script_4 = GhPythonScript(x=rhino_doc_dir_2)  # -> out, a; disabled
# ---------- ghpython_script_4: Python ----------
import os

a = os.path.abspath(os.path.join(x,"..","..","..","conmech"))
# ---------- end ghpython_script_4 ----------
shift_paths = ShiftPaths(Data=ghpython_script_3.elements, Offset=-1)  # disabled
panel_5 = Panel(ghpython_script_4.a)  # disabled
panel_6 = Panel(ghpython_script_2.out)
plane = Plane(ghpython_script_2.goal_poses)
number = Number(ghpython_script_2.radius)
point_2 = Point(ghpython_script_2.axispts_from_index)
panel_7 = Panel(ghpython_script_2.tags)

# ---- group: tool link
point_3 = Point(point)

# ----
panel_8 = Panel("""{*;0}
{*;1}
{*;2}
{*;3}""")
list_item = ListItem(List=point_2, Index=0, Wrap=True)  # -> Item, Item1
panel_9 = Panel("1e-12")  # disabled
list_item_2 = ListItem(List=shift_paths, Index=0, Wrap=True)  # -> flatten(Item); disabled
list_item_3 = ListItem(List=panel_8, Index=0, Wrap=True)  # -> Item, Item1, Item2, Item3

# ---- group: ee_path
plane_2 = Plane(ghpython_script_2.ee_paths)

# ---- group: grasp, indexed in seq_id
plane_3 = Plane(ghpython_script_2.grasps)

# ----
line = Line(StartPoint=list_item.Item, EndPoint=list_item.Item1)
ghpython_script_5 = GhPythonScript(
    conmech_dir=ghpython_script_4.a,
    save_dir=panel_4,
    conmech_file_name=panel_3,
    result_name=panel_2,
    limit_distance=panel_9)  # -> out, Model_out, fem_element_from_bar_id, sequence; disabled
# ---------- ghpython_script_5: Python ----------
import rhinoscriptsyntax as rs
import Rhino.Geometry.Plane as Plane
import Rhino.Geometry.Point3d as Point3d
import Rhino.Geometry.Vector3d as Vector3d
import Rhino.Geometry.Quaternion as Quat
import Grasshopper.DataTree as DataTree # Add, AddRange(list, GHPath(i, j))
import Grasshopper.Kernel.Data.GH_Path as GHPath
import System
from System.Collections.Generic import List

from ghpythonlib.treehelpers import list_to_tree, tree_to_list
import os
import json
##############################

import clr
# https://ironpython.net/documentation/dotnet/dotnet.html

clr.AddReferenceToFileAndPath("C:\Program Files\Rhino 6\Plug-ins\Karamba.gha")
clr.AddReferenceToFileAndPath("C:\Program Files\Rhino 6\Plug-ins\KarambaCommon.dll")

import feb # Karamba's C++ library (undocumented in the API)
import Karamba.Models.Model as Model
import Karamba.GHopper.Models.GH_Model as GH_Model
#
import Karamba
import Karamba.Elements.ModelTruss as Truss
from Karamba.Geometry import Point3, Line3, Vector3
from Karamba.CrossSections import CroSec
from Karamba.Supports import Support
from Karamba.Loads import Load
#
from Karamba.Utilities import MessageLogger, UnitsConversionFactories
import KarambaCommon
#
import System
from System import GC
from System.Collections.Generic import List

#####################################
# add path to conmech script folder
import os, sys 
sys.path.append(os.path.join(conmech_dir, "src", "pyconmech", "frame_analysis"))
#from io_base import Model
import io_base
import karamba_io
reload(io_base)
reload(karamba_io)
from karamba_io import KarambaModel
from io_base import LoadCase, GravityLoad

#####################################

with open(os.path.join(save_dir, 'test_data', conmech_file_name), 'r') as f:
    data = json.load(f)

print('{} | {}'.format(data["model_name"], data['generate_time']))
km = KarambaModel.from_data(data)
#lc = LoadCase.from_data(data['loadcases']['0'])

model = km.to_karamba(LoadCase(gravity_load=GravityLoad([0,0,-1])), limit_dist=limit_distance)

## calculate Th.I response
#logger = MessageLogger();
#k3d = KarambaCommon.Toolkit();
#max_disp = clr.Reference[List[float]]()
#out_g = clr.Reference[List[float]]()
#out_comp = clr.Reference[List[float]]()
#message = clr.Reference[str]()
#model = k3d.Algorithms.AnalyzeThI(model, max_disp, out_g, out_comp, message);
#
#ucf = UnitsConversionFactories.Conv();
#cm = ucf.cm();
#print "max disp: {} {}".format(cm.toUnit(max_disp.Value[0]), cm.unitB)
#
Model_out = Karamba.GHopper.Models.GH_Model(model);
#
#from Karamba.GHopper.CrossSections import GH_CrossSection
#a = List[GH_CrossSection]([GH_CrossSection(cs.to_karamba()) for cs in km.crosssecs])

fem_data = data['fem_element_from_bar_id']
fem_element_from_bar_id = DataTree[int]()
for i, es in fem_data.items():
    if int(i) >= 0:
        fem_element_from_bar_id.AddRange(es, GHPath(int(i)))

with open(os.path.join(save_dir, 'results', result_name), 'r') as f:
    rdata = json.load(f)

print('{}\n{}\n{}'.format(rdata["problem"], rdata['config'], rdata['write_time']))
sequence = [trans[1] for trans in rdata['stiffness_history']]
# ---------- end ghpython_script_5 ----------
shift_paths_2 = ShiftPaths(Data=ghpython_script_2.paths, Offset=-1)
shift_paths_3 = ShiftPaths(Data=plane_3, Offset=-1)
xy_plane = XYPlane(Origin=Point(0, 0, 0))
shift_paths_4 = ShiftPaths(Data=plane_2, Offset=-1)
panel_10 = Panel("""{*;0}
{*;1}""")
length = Length(Curve=line)
pipe = Pipe(Curve=line, Radius=number, Caps=0)
panel_11 = Panel(shift_paths_2)
split_tree = SplitTree(Data=shift_paths_2, Masks=flatten(list_item_3.Item1))  # -> Positive, Negative
split_tree_2 = SplitTree(Data=shift_paths_2, Masks=flatten(list_item_3.Item2))  # -> Positive, Negative
split_tree_3 = SplitTree(Data=shift_paths_2, Masks=flatten(list_item_3.Item))  # -> Positive, Negative
split_tree_4 = SplitTree(Data=shift_paths_2, Masks=flatten(list_item_3.Item3))  # -> Positive, Negative
clean = Button()
tree_statistics = TreeStatistics(Tree=shift_paths_3)  # -> Paths, Length, Count
split_tree_5 = SplitTree(Data=shift_paths_4, Masks=flatten(panel_10))  # -> Positive, Negative
python_karamba_model_converter = PythonKarambaModelConverter(
    Model_in=ghpython_script_5.Model_out,
    Reference=["C:\Program Files\Rhino 6\Plug-ins\karambaCommon.dll", "C:\Program Files\Rhino 6\Plug-ins\karamba.gha"])  # -> out, flatten(Model_out); disabled
# ---------- python_karamba_model_converter: Python usings ----------
using Karamba.Models;
using Karamba.GHopper.Models;
# ---------- python_karamba_model_converter: Python ----------
    var model = Model_in as Model;
    if (model == null) {
      throw new ArgumentException("The input in 'Model_in' is not of type karamba.Models.Model!");
    }

    Model_out = new GH_Model(model);

    Print("Everything OK");
# ---------- end python_karamba_model_converter ----------
disassemble_model_karamba3d = DisassembleModelKaramba3D(Model=python_karamba_model_converter.Model_out)  # -> Model, Point, Beam, Shell, Support, Load, Line, Mesh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; disabled
list_length = ListLength(List=disassemble_model_karamba3d.Beam)  # disabled
panel_12 = Panel(ghpython_script_5.fem_element_from_bar_id)  # disabled
orient = Orient(Geometry=line, Source=plane, Target=xy_plane)  # -> Geometry, Transform
partition_list = PartitionList(List=split_tree_2.Positive, Size=robot_dof)
wirecleaner = WireCleaner(on=clean, wire_type=Slider(1, range=0..2))  # -> out, a
# ---------- wirecleaner: Python ----------
from Grasshopper.Kernel import GH_ParamWireDisplay
from Grasshopper.Kernel import GH_RuntimeMessageLevel 

# A dictionary of wire types 
wire_display = {'0':GH_ParamWireDisplay.default, 
                '1':GH_ParamWireDisplay.faint,
                '2':GH_ParamWireDisplay.hidden}

# Get selected components and change the wire display
if on:
    doc = ghenv.Component.OnPingDocument()
    sel_objs = doc.SelectedObjects()
    if not len(sel_objs):
        ghenv.Component.AddRuntimeMessage(GH_RuntimeMessageLevel.Warning, 'Nothing was selected')
    for sel_obj  in sel_objs:
        if hasattr(sel_obj, 'Params'):
            for p in sel_obj.Params.Input:
                p.WireDisplay = wire_display[wire_type]
        else:
                sel_obj.WireDisplay = wire_display[wire_type]
# ---------- end wirecleaner ----------
partition_list_2 = PartitionList(List=split_tree.Positive, Size=robot_dof)
partition_list_3 = PartitionList(List=split_tree_4.Positive, Size=robot_dof)
partition_list_4 = PartitionList(List=split_tree_3.Positive, Size=robot_dof)
shift_paths_5 = ShiftPaths(Data=split_tree_5.Positive, Offset=-1)
integer = Integer(ghpython_script_2.elements)
shift_paths_6 = ShiftPaths(Data=integer, Offset=-1)

# ---- group: transfer
number_2 = Number(partition_list_4)

# ---- group: place retreat
number_3 = Number(partition_list)

# ---- group: transit
number_4 = Number(partition_list_3)

# ---- group: place approach
number_5 = Number(partition_list_2)

# ----
number_slider = Slider(1, range=1..50)  # disabled
unit_x = UnitX(Factor=1)
unit_y = UnitY(Factor=1)
list_item_4 = ListItem(List=shift_paths_6, Index=0, Wrap=True)

# ---- group: seq_id : beam_id
integer_2 = Integer(list_item_4)

# ---- group: bar sequence
integer_3 = Integer(flatten(integer_2))

# ----
replace_paths = ReplacePaths(Data=shift_paths_3, Search=tree_statistics.Paths, Replace=integer_3)
list_item_5 = ListItem(List=replace_paths, Index=0, Wrap=True)

# ---- group: bar at origin
geometry = Geometry(orient.Geometry)

# ----
text_2 = Text(ghpython_script_2.tags)

number_slider_2 = Slider(3, range=0..3)
bar_seq_id = Slider(1, range=0..20)
concatenate = Concatenate(Fragment_A="{", Fragment_B=bar_seq_id, A=";", C="*", B="}")
construct_path = ConstructPath(Indices=graft(bar_seq_id))  # -> flatten(Branch)
data_path = DataPath()

panel_13 = Panel("open gripper")
panel_14 = Panel("close gripper")
concatenate_2 = Concatenate(Fragment_A="; element #", Fragment_B=integer, A=", ", B=text_2)

# ---- group: bar base
xy_plane_2 = XYPlane(Origin=Point(0, 0, 0))

# ----
orient_2 = Orient(Geometry=list_item_5, Source=xy_plane_2, Target=shift_paths_5)  # -> Geometry, Transform
negative = Negative(Value=unit_x)
negative_2 = Negative(Value=unit_y)
number_slider_3 = Slider(19, range=0..19)  # disabled
split_list = SplitList(List=list_item_2, Index=number_slider_3)  # -> ListA, ListB; disabled
ghpython_script_6 = GhPythonScript(nE=list_length, bar_ids=split_list.ListA, fem_element_from_bar_id=ghpython_script_5.fem_element_from_bar_id)  # -> out, flatten(element_activation); inputs nE: Int32, bar_ids: list of Int32, fem_element_from_bar_id: tree of Int32; disabled
# ---------- ghpython_script_6: Python ----------
import rhinoscriptsyntax as rs
import Rhino.Geometry.Plane as Plane
import Rhino.Geometry.Point3d as Point3d
import Rhino.Geometry.Vector3d as Vector3d
import Rhino.Geometry.Quaternion as Quat
import Grasshopper.DataTree as DataTree # Add, AddRange(list, GHPath(i, j))
import Grasshopper.Kernel.Data.GH_Path as GHPath
import System

from ghpythonlib.treehelpers import list_to_tree, tree_to_list

fem_elements_from_bar = tree_to_list(fem_element_from_bar_id, lambda x:x)
#print fem_elements_from_bar
element_activation = [False for i in range(nE)]
for b in bar_ids:
    for e in fem_elements_from_bar[b]:
        element_activation[e] = True
# ---------- end ghpython_script_6 ----------
panel_15 = Panel(split_list.ListA)  # disabled
element_activation_karamba3d = ElementActivationKaramba3D(Model=python_karamba_model_converter.Model_out, IsActive=ghpython_script_6.element_activation)  # disabled
panel_16 = Panel(ghpython_script_6.element_activation)  # disabled
analyze_karamba3d = AnalyzeKaramba3D(Model=element_activation_karamba3d)  # -> CalculatedModel, MaximumDisplacement_cm, ResultingForceOfGravity_kN, ElasticEnergy_kNm; disabled
eigen_modes_karamba3d = EigenModesKaramba3D(
    Model=analyze_karamba3d.CalculatedModel,
    FromIndex=number_slider,
    NumberOfModes=1,
    MaximumNumberOfIterations=300,
    Epsilon=1e-07)  # -> ModelWithEigenModesAsLoadCaseResults, Eigenvalues; disabled
orient_3 = Orient(Geometry=geometry, Source=xy_plane_2, Target=orient_2.Geometry)  # -> Geometry, Transform
merge = Merge(Data2=number_2, Data3=number_5, Data5=number_3, Data6=number_4)
construct_plane = ConstructPlane(Origin=point_3, XAxis=negative, YAxis=negative_2)
xy_plane_3 = XYPlane(Origin=point_3)
panel_17 = Panel(ghpython_script_5.sequence)  # disabled
multiplication = Multiplication(A=analyze_karamba3d.MaximumDisplacement_cm, B=0.01)  # disabled
panel_18 = Panel(concatenate_2)
subtraction = Subtraction(A=number_slider_3, B=1)  # disabled

# ---- group: tool_from_bar
orient_4 = Orient(Geometry=geometry, Source=xy_plane_2, Target=list_item_5)  # -> Geometry, Transform

# ----
panel_19 = Panel(eigen_modes_karamba3d.Eigenvalues)  # disabled
tree_statistics_2 = TreeStatistics(Tree=merge)  # -> Paths, Length, Count
panel_20 = Panel(multiplication)  # disabled
list_item_6 = ListItem(List=panel_17, Index=subtraction, Wrap=False)  # disabled
model_view_karamba3d = ModelViewKaramba3D(Model=analyze_karamba3d.CalculatedModel, ResultFactors=1, ResultCase=-1)  # -> Model, DeformedMesh, DeformedAxes, DeformedModel; disabled
orient_5 = Orient(Geometry=orient_4.Geometry, Source=xy_plane_2, Target=xy_plane_3)  # -> Geometry, Transform
panel_21 = Panel(tree_statistics_2.Paths)
list_item_7 = ListItem(List=tree_statistics_2.Paths, Index=Slider(0, range=0..1268), Wrap=True)
panel_22 = Panel(list_item_6)  # disabled
jaw = Panel("40")
addition = Addition(A=bar_seq_id, B=1)
tree_branch = TreeBranch(Tree=merge, Path=list_item_7, MaintainPaths=True)
division = Division(A=jaw, B="2")

# ---- group: bar sequence
integer_4 = Integer(integer_2)

# ----
end_points = EndPoints(Curve=orient_5.Geometry)  # -> Start, End
beam_view_karamba3d = BeamViewKaramba3D(Model=model_view_karamba3d.Model)  # -> Model, MeshesOfRenderedBeams, DeformedBeamAxes, LegendColors, LegendTags; disabled

# ---- group: indexed by bar ids
curve = Curve(orient_5.Geometry)
number_6 = Number(number)

# ----
split_list_2 = SplitList(List=flatten(integer_4), Index=addition)  # -> simplify(graft(ListA)), ListB
tree_branch_2 = TreeBranch(Tree=integer_4, Path=construct_path, MaintainPaths=True)
brep = Brep(simplify(pipe))
construct_path_2 = ConstructPath(Indices=split_list_2.ListA)  # -> flatten(Branch)

# ---- group: left point
merge_2 = Merge(Data1=end_points.Start, Data2=end_points.End)
deconstruct = Deconstruct(Point=merge_2)  # -> XComponent, YComponent, ZComponent
point_4 = Point(merge_2)
sort_list = SortList(Keys=deconstruct.YComponent, ValuesValuesA=point_4)  # -> Keys, ValuesValuesA
list_item_8 = ListItem(List=sort_list.ValuesValuesA, Index=0, Wrap=True)  # -> Item, Item1

# ----
split_tree_6 = SplitTree(Data=brep, Masks=flatten(construct_path_2))  # -> Positive, Negative
construct_path_3 = ConstructPath(Indices=tree_branch_2)
split_tree_7 = SplitTree(Data=number_6, Masks=flatten(construct_path))  # -> Positive, Negative
split_tree_8 = SplitTree(Data=curve, Masks=flatten(construct_path_3))  # -> Positive, Negative
brep_2 = Brep(split_tree_6.Positive)
panel_23 = Panel("D:\code_ws\pb_ws\coop_assembly\src\coop_assembly\data\models")
point_5 = Point(list_item_8.Item)

# ---- group: gripper mesh at the origin
mesh = Mesh()

# ----
point_6 = Point(point_3)
pipe_2 = Pipe(Curve=split_tree_8.Positive, Radius=split_tree_7.Positive, Caps=0)
distance = Distance(PointA=list_item_8.Item, PointB=point_6)
distance_2 = Distance(PointA=list_item_8.Item1, PointB=point_6)
number_7 = Number(division)
subtraction_2 = Subtraction(A=distance_2, B=number_7)
subtraction_3 = Subtraction(A=distance, B=number_7)
boolean_toggle = BooleanToggle(False)
number_8 = Number(flatten(length))
integer_5 = Integer(flatten(integer_2))
number_9 = Number(flatten(subtraction_3))

# ----
# Robot
load = Button()
ghpython_script_7 = PythonScript(load=load, pkg_path=panel_23, pkg_name="abb_irb4600_40_255", urdf_file="ECL_robot1_with_track.urdf")  # -> out, robot
# ---------- ghpython_script_7: Python ----------
from scriptcontext import sticky as st
import os
import compas

from compas.robots import RobotModel
from compas.robots import GithubPackageMeshLoader
from compas.robots import LocalPackageMeshLoader
from compas_fab.robots import Robot
from compas_ghpython.artists import RobotModelArtist

# Robot meshes are usually in meters
# Set a high percision to prevent parsing errors
# and configure Rhino itself in meters
compas.PRECISION = '12f'

# Store robot in component-based key
robot_key = 'robot_{}'.format(str(ghenv.Component.InstanceGuid))

if robot_key not in st:
    st[robot_key] = None

if load:
    # Also load geometry
    loader = LocalPackageMeshLoader(pkg_path, pkg_name)
    
    # Create robot model from URDF
    model = RobotModel.from_urdf_string(loader.load_urdf(urdf_file).read())
    model.load_geometry(loader)

    artist = RobotModelArtist(model)
    robot = Robot(model, artist)
    st[robot_key] = robot

robot = st[robot_key]

#repo    = 'ros-industrial/abb'
#package = 'abb_irb6600_support'
#branch  = 'kinetic-devel'
#
#github = GithubPackageMeshLoader(repo, package, branch)
#
#model = RobotModel.from_urdf_file(github.load_urdf('irb6640.urdf'))
#model.load_geometry(github)
#artist = RobotModelArtist(model)
#robot = Robot(model, artist)
# ---------- end ghpython_script_7 ----------
robot = Data(ghpython_script_7.robot)

jaw_right_length = Panel(subtraction_2)
list_item_9 = ListItem(List=number_8, Index=integer_5, Wrap=True)
list_item_10 = ListItem(List=number_9, Index=integer_5, Wrap=True)
panel_24 = Panel(ghpython_script_7.out)
sort_list_2 = SortList(Keys=integer_5)  # -> Keys, ValuesValuesA
panel_25 = Panel(robot)

# ---- group: meter, degree
# Configuration
gantry = Slider(0, range=0..4)
a1 = Slider(-27, range=-360..360)
a2 = Slider(-40, range=-360..360)
a4 = Slider(0, range=-360..360)
a5 = Slider(0, range=-360..360)
a3 = Slider(-20, range=-360..360)
a6 = Slider(0, range=-360..360)
forward_kinematics = PythonScript(robot=robot, x=gantry, a1=a1, a2=a2, a3=a3, a4=a4, a5=a5, a6=a6)  # -> configuration
# ---------- forward_kinematics: Python ----------
import math
from compas_fab.robots import Configuration

if robot:
    joint_values = [a1, a2, a3, a4, a5, a6]
    joint_names = robot.get_configurable_joint_names()
    configuration = Configuration.from_prismatic_and_revolute_values([x], 
        [math.radians(a) for a in joint_values])
# ---------- end forward_kinematics ----------

# ---- group: meter, radians
# Configuration
list_item_11 = ListItem(List=tree_branch, Index=0, Wrap=True)  # -> Item, Item1, Item2, Item3, Item4, Item5, Item6
forward_kinematics_2 = PythonScript(
    robot=robot,
    x=list_item_11.Item,
    a1=list_item_11.Item1,
    a2=list_item_11.Item2,
    a3=list_item_11.Item3,
    a4=list_item_11.Item4,
    a5=list_item_11.Item5,
    a6=list_item_11.Item6)  # -> configuration
# ---------- forward_kinematics_2: Python ----------
import math
from compas_fab.robots import Configuration

if robot:
    joint_values = [a1, a2, a3, a4, a5, a6]
    joint_names = robot.get_configurable_joint_names()
    configuration = Configuration.from_prismatic_and_revolute_values([x], 
        [a for a in joint_values])
# ---------- end forward_kinematics_2 ----------

# ----
seq_id_bar_length_in_mil = Panel(list_item_9)
seq_id_jaw_left_length = Panel(list_item_10)
seq_id_element_id = Panel(integer_5)

beam_id_bar_length_in_mil = Panel(number_8)
beam_id_beam_left_length = Panel(number_9)
element_id = Panel(sort_list_2.Keys)

# ---- group: beam geometry
mesh_2 = Mesh()

# ---- group: environment collision objects
mesh_3 = Mesh([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])

# ----
configurations_at_pickup = Data(forward_kinematics_2)

# ----
# Visualisation
show_end_effector_frame = BooleanToggle(False)
show_base_frame = BooleanToggle(False)
show_collision = BooleanToggle(False)
show_frames = BooleanToggle(False)
show_visual = BooleanToggle(True)
visualize = PythonScript(
    robot=robot,
    configuration=configurations_at_pickup,
    show_visual=show_visual,
    show_collision=show_collision,
    show_frames=show_frames,
    show_base_frame=show_base_frame,
    show_end_effector_frame=show_end_effector_frame)  # -> out, visual, collision, frames, ee_frame, base_frame
# ---------- visualize: Python ----------
"""Visualizes a robot.
    Inputs:
        robot: The robot
        configuration: :class:`compas_fab.robots.Configuration`
            The robot's full configuration to display.
        show_visual: bool
           Whether or not to show the robot's visual meshes.
        show_collision: bool
           Whether or not to show the robot's collision meshes.
        show_frames: bool
           Whether or not to show the robot's joint frames.
        show_base_frame: bool
           Whether or not to show the robot's base frame.
        show_end_effector_frame: bool
            Whether or not to show the robot's end-effector frame.
    Output:
        visual: The robot's visual meshes.
        collision: The robot's collision meshes.
        frames: The robot's joint frames.
        base_frame: The robot's base frame.
        ee_frame: The robot's end-effector frame.
"""
from __future__ import print_function

if robot and configuration:
    group = group or robot.main_group_name if robot.semantics else None
    robot.update(configuration, group, visual=show_visual, collision=show_collision)
    
    if show_visual:
        visual = robot.artist.draw_visual()

    if show_collision:
        collision = robot.artist.draw_collision()

    if show_frames:
        axes = robot.transformed_axes(configuration, group)
        frames = robot.transformed_frames(configuration, group)

    if show_base_frame:
        frames = robot.transformed_frames(configuration, group)
        base_frame = frames[0]

    if show_end_effector_frame:
        ee_frame = robot.forward_kinematics(configuration, group)
        print("End-effector", ee_frame)
# ---------- end visualize ----------
draw = GhPythonScript(frames=[visualize.frames, visualize.ee_frame, visualize.base_frame], scale=Slider(0.1, range=0..1))  # -> P, V, C, W, flatten(planes); inputs frames: list
# ---------- draw: Python ----------
from System.Drawing import Color
from compas_ghpython import draw_frame

red = Color.FromArgb(255, 0, 0)
green = Color.FromArgb(0, 255, 0)
blue = Color.FromArgb(0, 0, 255)

P = []
V = []
C = []
planes = []

scale = float(scale)

for frame in frames:
    if not frame:
        continue
    plane = draw_frame(frame)
    P += [plane.Origin] * 3
    V.append(plane.XAxis * scale)
    V.append(plane.YAxis * scale)
    V.append(plane.ZAxis * scale)
    C += [red, green, blue]
    planes.append(plane)

W = 3
# ---------- end draw ----------
vector_display_ex = VectorDisplayEx(Point=draw.P, Vector=draw.V, Colour=draw.C, Width=draw.W)
geometry_2 = Geometry(visualize.collision)
geometry_3 = Geometry(visualize.visual)

list_item_12 = ListItem(List=visualize.frames, Index=Slider(21, range=0..43), Wrap=True)
ghpython_script_8 = GhPythonScript(x=list_item_12)  # -> out, a
# ---------- ghpython_script_8: Python ----------
from compas_ghpython import draw_frame

a = draw_frame(x)
# ---------- end ghpython_script_8 ----------
xy_plane_4 = XYPlane(Origin=Point(0, 0, 0))
plane_4 = Plane(ghpython_script_8.a)
orient_6 = Orient(Geometry=mesh_2, Source=xy_plane_4, Target=plane_4)  # -> Geometry, Transform
