# Grasshopper definition plan_to_kuka_src.gh (Grasshopper 1.0.7)
# plug-ins: KUKA|prc - parametric robot control

# ---- group: bar diameter
number = Number("3.17")

# ----
# 1/4 inch OD rod, 3.175 mm radius
# rack start pt
# rack direction pt
# caliberated TCP value
# original TCP
# EE visual mesh
# EE visual mesh
# Y moving distance
# connect escape distance after printing
number_slider = Slider(52.512, range=0..100)
sine = Sine(Value=degrees(number_slider))
division = Division(A=number, B="2")
division_2 = Division(A=division, B=sine)
panel = Panel(division_2)
point = Point(Point(431.62, 408.76, 125.148736))
addition = Addition(A=division_2, B="1")
subtraction = Subtraction(A="52.33", B=Slider(10, range=0..10))
unit_z = UnitZ(Factor=addition)
unit_x = UnitX(Factor=subtraction)
addition_2 = Addition(A=unit_z, B=unit_x)
move = Move(Geometry=point, Motion=addition_2)  # -> Geometry, Transform
point_2 = Point(move.Geometry)
unit_x_2 = UnitX(Factor=1)
point_3 = Point(point_2)
move_2 = Move(Geometry=point_3, Motion=unit_x_2)  # -> Geometry, Transform
point_4 = Point(move_2.Geometry)

# ----
# table model in the origin
brep = Brep(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)

rhino_doc_dir = RhinoDocDir()  # -> rhino_doc_dir
# ---------- rhino_doc_dir: Python ----------
import scriptcontext as sc
from os import path

rhino_doc_dir = path.abspath(path.dirname(sc.doc.Path))
# ---------- end rhino_doc_dir ----------
point_5 = Point("600, 0, -14.23")

# ----
# bar rack
brep_2 = Brep(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)
point_6 = Point("431.62, 421.26, 131.61")

ghpython_script = GhPythonScript(x=rhino_doc_dir)  # -> out, a
# ---------- ghpython_script: Python ----------
import os

a = os.path.join(x, '..', '..', 
    'src\coop_assembly\data\models\kuka_kr6_r900\meshes\mit_arch_grasp_end_effector')
# ---------- end ghpython_script ----------
move_3 = Move(Geometry=brep, Motion=point_5)  # -> Geometry, Transform
ghpython_script_2 = GhPythonScript(
    file_dir=ghpython_script.a,
    collision_file_name="mit_arch_grasp_end_effector_collision.stl",
    virtual_file_name="mit_arch_grasp_end_effector_visual.stl")  # -> out, collision_mesh, virutal_mesh
# ---------- ghpython_script_2: Python ----------
import rhinoscriptsyntax as rs
import Rhino.Geometry.Plane as Plane
import Rhino.Geometry.Point3d as Point3d
import Rhino.Geometry.Vector3d as Vector3d
import Rhino.Geometry.Quaternion as Quat
import Grasshopper.DataTree as DataTree # Add, AddRange(list, GHPath(i, j))
import Grasshopper.Kernel.Data.GH_Path as GHPath
import System

from ghpythonlib.treehelpers import list_to_tree, tree_to_list

#import json
#from compas.geometry import Frame
#from compas_ghpython import draw_pipes, draw_frame

import compas
from compas.datastructures import Mesh
from compas_ghpython.artists import MeshArtist
import os

collision_fp = os.path.join(file_dir, 'collision', collision_file_name)
#virtual_fp = os.path.join(file_dir, 'visual', virtual_file_name)

collision_cp_mesh = Mesh.from_stl(collision_fp)
#virtual_cp_mesh = Mesh.from_stl(virtual_fp)

collision_mesh = MeshArtist(collision_cp_mesh).draw_mesh()
#virtual_mesh = MeshArtist(virtual_cp_mesh).draw_vertices()
# ---------- end ghpython_script_2 ----------

# ---- group: MIT grasp end effector
# visual model
mesh = Mesh([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])

# ----
mesh_2 = Mesh(ghpython_script_2.collision_mesh)
mesh_3 = Mesh(mesh)
mesh_4 = Mesh(mesh_2)

# ----
# TCP Calibration Point
point_7 = Point(Point(-2.851003028, 1.035000463, 188.1551834))
point_8 = Point("0,0, 185.795")

# ---- group: caliberated TCP pt
point_9 = Point(point_7)

# ---- group: original visual TCP pt
point_10 = Point(point_7)

# ----
panel_2 = Panel(point_9)
panel_3 = Panel(point_10)

# ----
# original tool tip
# caliberated TCP tip
# the eef frame in the URDF needs to be shifted accordingly!
point_11 = Point(point_9)
point_12 = Point(point_10)
vector_2pt = Vector2Pt(PointA=point_12, PointB=point_11, Unitize=False)  # -> Vector, Length
division_3 = Division(A=vector_2pt.Vector, B="1000")
division_4 = Division(A=point_11, B="1000")
panel_4 = Panel(division_3)
panel_5 = Panel(division_4)

panel_6 = Panel("cube.json_regression_solution.json")

# ----
# Open gripper IO command
panel_7 = Panel("""; open gripper
HALT
$OUT[2] = TRUE
$OUT[5] = FALSE
HALT""")

# ----
# Close gripper IO command
panel_8 = Panel("""; close gripper
HALT
$OUT[2] = FALSE
$OUT[5] = TRUE
HALT""")

text = Text(rhino_doc_dir)
ghpython_script_3 = GhPythonScript(x=text, y="octet.json_regression_solution.json")  # -> out, a
# ---------- ghpython_script_3: Python ----------
import os

a = os.path.join(x, '..', '..', 
    'tests', 'results', y)
# ---------- end ghpython_script_3 ----------
panel_9 = Panel(ghpython_script_3.a)
kuka_prc_custom_krl = KUKAPrcCustomKRL(TextAsKRL=panel_8)
kuka_prc_custom_krl_2 = KUKAPrcCustomKRL(TextAsKRL=panel_7)
ghpython_script_4 = GhPythonScript(result_file_path=ghpython_script_3.a, ee_link_name="eef_tcp_frame", scale="1e3")  # -> out, paths, ee_paths, elements, tags, grasps, axispts_from_index, radius, goal_poses
# ---------- ghpython_script_4: Python ----------
import rhinoscriptsyntax as rs
import Rhino.Geometry.Plane as Plane
import Rhino.Geometry.Point3d as Point3d
import Rhino.Geometry.Vector3d as Vector3d
import Rhino.Geometry.Quaternion as Quat
import Rhino.Geometry.Line as Line
import Rhino.Geometry.Transform as Transform
import Grasshopper.DataTree as DataTree # Add, AddRange(list, GHPath(i, j))
import Grasshopper.Kernel.Data.GH_Path as GHPath
import System

from ghpythonlib.treehelpers import list_to_tree, tree_to_list

import json
from compas.geometry import Frame
from compas.geometry import scale_points
from compas_ghpython import draw_pipes, draw_frame
from itertools import islice

######################################

def pose_from_frame(frame, scale=1.0):
    """Returns a PyBullet pose from a frame.
    Parameters
    ----------
    frame : :class:`compas.geometry.Frame`
    Returns
    -------
    point, quaternion : tuple
    """
    return ([v*scale for v in frame.point], frame.quaternion.xyzw)


def frame_from_pose(pose, scale=1.0):
    """Returns a frame from a PyBullet pose.
    Parameters
    ----------
    point, quaternion : tuple
    Returns
    -------
    :class:`compas.geometry.Frame`
    """
    point, (x, y, z, w) = pose
    return Frame.from_quaternion([w, x, y, z], point=[v*scale for v in point])

#########################################

with open(result_file_path) as json_file:
    data = json.load(json_file)

print('file_name: {}'.format(data['problem']))
try:
    print('write_time: {}'.format(data['write_time']))
except:
    pass

paths = DataTree[System.Double]()
ee_paths = DataTree[Plane]()
elements = DataTree[System.Int32]()
tags = DataTree[System.String]()
grasps = DataTree[Plane]()
for seq_id, e_trajs in enumerate(data['plan']):
    if seq_id == 0:
        del e_trajs[0]
    for sp_id, traj in enumerate(e_trajs):
        path = traj['path']
        epath = traj['link_path'][ee_link_name]
        for t_id, (conf, epose) in enumerate(zip(path, epath)):
            conf = [float(v) for v in conf]
            paths.AddRange(conf, GHPath(seq_id, sp_id, t_id))
            ee_paths.Add(draw_frame(frame_from_pose(epose, scale)), GHPath(seq_id, sp_id, t_id))
            
        if traj['element'] is not None: 
            elements.Add(traj['element'], GHPath(seq_id, sp_id))
        else:
            elements.Add(-1000, GHPath(seq_id, sp_id))
        tags.Add(traj['tag'], GHPath(seq_id, sp_id))
        
        for attach_data in traj['attachments']:
            g_frame = frame_from_pose(attach_data['grasp_pose'], scale=scale)
            grasps.Add(draw_frame(g_frame), GHPath(seq_id, sp_id))
            
            
axispts_from_index = DataTree[Point3d]()
radius = DataTree[System.Double]()
goal_poses = DataTree[Plane]()
for e_id, edata in data['element_from_index'].items():
    radius.Add(edata['radius']*scale, GHPath(int(e_id)))
    
    goal_frame = frame_from_pose(edata['goal_pose']['value'], scale=scale)
    goal_poses.Add(draw_frame(goal_frame), GHPath(int(e_id)))
    
    scaled_pts = scale_points(edata['axis_endpoints'], scale)
    for i in range(2):
        axispts_from_index.Add(Point3d(*scaled_pts[i]), GHPath(int(e_id)))
# ---------- end ghpython_script_4 ----------
panel_10 = Panel(ghpython_script_4.out)
panel_11 = Panel("""{*;0}
{*;1}
{*;2}
{*;3}""")
plane = Plane(ghpython_script_4.goal_poses)
number_2 = Number(ghpython_script_4.radius)
point_13 = Point(ghpython_script_4.axispts_from_index)
panel_12 = Panel(ghpython_script_4.tags)
list_item = ListItem(List=panel_11, Index=0, Wrap=True)  # -> Item, Item1, Item2, Item3
list_item_2 = ListItem(List=point_13, Index=0, Wrap=True)  # -> Item, Item1
shift_paths = ShiftPaths(Data=ghpython_script_4.paths, Offset=-1)

# ---- group: ee_path
plane_2 = Plane(ghpython_script_4.ee_paths)

# ---- group: grasp, indexed in seq_id
plane_3 = Plane(ghpython_script_4.grasps)

# ----
line = Line(StartPoint=list_item_2.Item, EndPoint=list_item_2.Item1)
panel_13 = Panel(shift_paths)
split_tree = SplitTree(Data=shift_paths, Masks=flatten(list_item.Item2))  # -> Positive, Negative
split_tree_2 = SplitTree(Data=shift_paths, Masks=flatten(list_item.Item1))  # -> Positive, Negative
shift_paths_2 = ShiftPaths(Data=plane_3, Offset=-1)
xy_plane = XYPlane(Origin=Point(0, 0, 0))
shift_paths_3 = ShiftPaths(Data=plane_2, Offset=-1)
panel_14 = Panel("""{*;0}
{*;1}""")
split_tree_3 = SplitTree(Data=shift_paths, Masks=flatten(list_item.Item))  # -> Positive, Negative
split_tree_4 = SplitTree(Data=shift_paths, Masks=flatten(list_item.Item3))  # -> Positive, Negative
length = Length(Curve=line)
pipe = Pipe(Curve=line, Radius=number_2, Caps=0)
transition_joint_speed = Slider(100, range=0..100)
tree_statistics = TreeStatistics(Tree=shift_paths_2)  # -> Paths, Length, Count
split_tree_5 = SplitTree(Data=shift_paths_3, Masks=flatten(panel_14))  # -> Positive, Negative
orient = Orient(Geometry=line, Source=plane, Target=xy_plane)  # -> Geometry, Transform
partition_list = PartitionList(List=split_tree.Positive, Size="6")
partition_list_2 = PartitionList(List=split_tree_4.Positive, Size="6")
partition_list_3 = PartitionList(List=split_tree_2.Positive, Size="6")
partition_list_4 = PartitionList(List=split_tree_3.Positive, Size="6")
number_3 = Number()
number_4 = Number()
number_5 = Number(partition_list_3)
number_6 = Number(partition_list)
shift_paths_4 = ShiftPaths(Data=split_tree_5.Positive, Offset=-1)
number_7 = Number(partition_list_4)
number_8 = Number(partition_list_2)
cluster = Cluster(radians=number_7, speed=transition_joint_speed)
cluster_2 = Cluster(radians=number_4, speed=transition_joint_speed)
cluster_3 = Cluster(radians=number_8, speed=transition_joint_speed)
cluster_4 = Cluster(radians=number_6, speed=transition_joint_speed)
integer = Integer(ghpython_script_4.elements)
shift_paths_5 = ShiftPaths(Data=integer, Offset=-1)
list_item_3 = ListItem(List=shift_paths_5, Index=0, Wrap=True)
text_2 = Text(ghpython_script_4.tags)
cluster_5 = Cluster(radians=number_3, speed=transition_joint_speed)
cluster_6 = Cluster(radians=number_5, speed=transition_joint_speed)
unit_x_3 = UnitX(Factor=1)
unit_y = UnitY(Factor=1)

# ---- group: bar at origin
geometry = Geometry(orient.Geometry)

# ----
concatenate = Concatenate(Fragment_A="; element #", Fragment_B=integer, A=", ", B=text_2)

# ---- group: bar base
xy_plane_2 = XYPlane(Origin=Point(0, 0, 0))

# ----
negative = Negative(Value=unit_x_3)
negative_2 = Negative(Value=unit_y)

# ---- group: transfer
kuka_prc_command = KUKAPrcCommand(cluster)

# ---- group: pick approach
kuka_prc_command_2 = KUKAPrcCommand(cluster_2)

# ---- group: close gripper IO
kuka_prc_command_3 = KUKAPrcCommand(kuka_prc_custom_krl)

# ---- group: open gripper IO
kuka_prc_command_4 = KUKAPrcCommand(kuka_prc_custom_krl_2)

# ---- group: pick retreat
kuka_prc_command_5 = KUKAPrcCommand(cluster_5)

# ---- group: place approach
kuka_prc_command_6 = KUKAPrcCommand(cluster_6)

# ---- group: place retreat
kuka_prc_command_7 = KUKAPrcCommand(cluster_4)

# ---- group: transit
kuka_prc_command_8 = KUKAPrcCommand(cluster_3)

# ----
kuka_prc_custom_krl_3 = KUKAPrcCustomKRL(TextAsKRL=concatenate)
panel_15 = Panel(kuka_prc_command)
cluster_7 = Cluster_2(list=cluster_6, list_b=kuka_prc_command_4)
cluster_8 = Cluster_2(list=kuka_prc_command, list_b=kuka_prc_command_3)
merge = Merge(
    Data1=cluster_8,
    Data2=kuka_prc_command,
    Data6=kuka_prc_command_6,
    Data7=cluster_7,
    Data8=kuka_prc_command_7,
    Data9=kuka_prc_command_8)
kuka_prc_command_9 = KUKAPrcCommand(merge)
jaw = Panel("40")
division_5 = Division(A=jaw, B="2")
merge_2 = Merge(Data1=kuka_prc_custom_krl_3, Data2=kuka_prc_command_9)
tree_statistics_2 = TreeStatistics(Tree=merge_2)  # -> Paths, Length, Count
brep_3 = Brep(simplify(pipe))
panel_16 = Panel(tree_statistics_2.Paths)
shift_paths_6 = ShiftPaths(Data=merge_2, Offset=-1)
tree_statistics_3 = TreeStatistics(Tree=shift_paths_6)  # -> Paths, Length, Count
kuka_prc_command_10 = KUKAPrcCommand(flatten(shift_paths_6))
kuka_prc_command_11 = KUKAPrcCommand(kuka_prc_custom_krl_2)
merge_3 = Merge(Data1=kuka_prc_command_11, Data2=kuka_prc_command_10)
number_9 = Number(division_5)

# ---- group: seq_id : beam_id
integer_2 = Integer(list_item_3)

# ---- group: bar sequence
integer_3 = Integer(flatten(integer_2))

# ----
replace_paths = ReplacePaths(Data=shift_paths_2, Search=tree_statistics.Paths, Replace=integer_3)
list_item_4 = ListItem(List=replace_paths, Index=0, Wrap=True)
orient_2 = Orient(Geometry=list_item_4, Source=xy_plane_2, Target=shift_paths_4)  # -> Geometry, Transform
orient_3 = Orient(Geometry=geometry, Source=xy_plane_2, Target=orient_2.Geometry)  # -> Geometry, Transform

# ---- group: tool_from_bar
orient_4 = Orient(Geometry=geometry, Source=xy_plane_2, Target=list_item_4)  # -> Geometry, Transform

# ---- group: bar sequence
integer_4 = Integer(integer_2)

# ----
number_10 = Number(flatten(length))
integer_5 = Integer(flatten(integer_2))
list_item_5 = ListItem(List=number_10, Index=integer_5, Wrap=True)
sort_list = SortList(Keys=integer_5)  # -> Keys, ValuesA
beam_id_bar_length_in_mil = Panel(number_10)
element_id = Panel(sort_list.Keys)

# ----
# Robot Model
# End effector setup
kuka_agilus_kr6_kr10_r900 = KUKAAgilusKR6KR10R900(highresactive=False, infiniterot=False)
point_14 = Point("-0.002851003, 0.001035, 0.188155183")

multiplication = Multiplication(A=point_14, B=1000)

# ---- group: tool link
point_15 = Point(multiplication)

# ----
construct_plane = ConstructPlane(Origin=point_15, XAxis=negative, YAxis=negative_2)
xy_plane_3 = XYPlane(Origin=point_15)
orient_5 = Orient(Geometry=orient_4.Geometry, Source=xy_plane_2, Target=xy_plane_3)  # -> Geometry, Transform
end_points = EndPoints(Curve=orient_5.Geometry)  # -> Start, End

# ---- group: indexed by bar ids
number_11 = Number(number_2)
curve = Curve(orient_5.Geometry)

# ---- group: left point
merge_4 = Merge(Data1=end_points.Start, Data2=end_points.End)
deconstruct = Deconstruct(Point=merge_4)  # -> XComponent, YComponent, ZComponent
point_16 = Point(merge_4)
sort_list_2 = SortList(Keys=deconstruct.YComponent, ValuesValuesA=point_16)  # -> Keys, ValuesValuesA
list_item_6 = ListItem(List=sort_list_2.ValuesValuesA, Index=0, Wrap=True)  # -> Item, Item1

# ----
point_17 = Point(list_item_6.Item)
point_18 = Point(point_15)
distance = Distance(PointA=list_item_6.Item, PointB=point_18)
distance_2 = Distance(PointA=list_item_6.Item1, PointB=point_18)
subtraction_2 = Subtraction(A=distance_2, B=number_9)
subtraction_3 = Subtraction(A=distance, B=number_9)
number_12 = Number(flatten(subtraction_3))
jaw_right_length = Panel(subtraction_2)
list_item_7 = ListItem(List=number_12, Index=integer_5, Wrap=True)

# ----
# Handcutting instruction!
seq_id_bar_length_in_mil = Panel(list_item_5)
seq_id_jaw_left_length = Panel(list_item_7)
seq_id_element_id = Panel(integer_5)

beam_id_beam_left_length = Panel(number_12)

number_slider_2 = Slider(3, range=0..3)
bar_seq_id = Slider(1, range=0..20)
concatenate_2 = Concatenate(Fragment_A="{", Fragment_B=bar_seq_id, A=";", C="*", B="}")
construct_path = ConstructPath(Indices=graft(bar_seq_id))  # -> flatten(Branch)
split_tree_6 = SplitTree(Data=shift_paths_6, Masks=flatten(construct_path))  # -> Positive, Negative

addition_3 = Addition(A=bar_seq_id, B=1)
split_list = SplitList(List=flatten(tree_statistics_3.Paths), Index=addition_3)  # -> simplify(graft(ListA)), ListB
split_list_2 = SplitList(List=flatten(integer_4), Index=addition_3)  # -> simplify(graft(ListA)), ListB
construct_path_2 = ConstructPath(Indices=split_list_2.ListA)  # -> flatten(Branch)
tree_branch = TreeBranch(Tree=integer_4, Path=construct_path, MaintainPaths=True)

data_path = DataPath(split_list.ListB)

split_tree_7 = SplitTree(Data=brep_3, Masks=flatten(construct_path_2))  # -> Positive, Negative
construct_path_3 = ConstructPath(Indices=tree_branch)
split_tree_8 = SplitTree(Data=number_11, Masks=flatten(construct_path))  # -> Positive, Negative
brep_4 = Brep(split_tree_7.Positive)
split_tree_9 = SplitTree(Data=curve, Masks=flatten(construct_path_3))  # -> Positive, Negative
pipe_2 = Pipe(Curve=split_tree_9.Positive, Radius=split_tree_8.Positive, Caps=0)
geometry_2 = Geometry(pipe_2)
mesh_brep = MeshBrep(
    Brep=geometry_2,
    Settings={GridMaxCount=0, GridMinCount=16, JaggedSeams=False, MaxEdgeLength=0, MinEdgeLength=0.0001, MinTolerance=0, Refine=True, RefineAngle=0, RelativeTolerance=0.65, SimplePlanes=True, Tolerance=0})

use_collision_ee_model = BooleanToggle(False)

stream_filter = StreamFilter(Gate=use_collision_ee_model, Stream0=mesh_3, Stream1=mesh_4)

merge_5 = Merge(Data1=stream_filter, Data2=mesh_brep)  # -> flatten(Result)

mesh_join = MeshJoin(Meshes=merge_5)
move_4 = Move(Geometry=mesh_join, Motion=vector_2pt.Vector)  # -> Geometry, Transform
custom_tool_for_kuka_prc = CustomToolForKUKAPrc(
    CustomToolGeometry=move_4.Geometry,
    toolid=6,
    toolvala=0,
    toolvalb=0,
    toolvalc=0,
    toolvalx=-2.85,
    toolvaly=1.035,
    toolvalz=188.155,
    valuesset=True)

# ---- group: gripper mesh at the origin
mesh_5 = Mesh(mesh_join)

# ----
kuka_prc_core = KUKAPrcCORE(
    SimulationSlider=Slider(0.7411, range=0..1),
    KUKAPrcCommands=merge_3,
    KUKAPrcTool=custom_tool_for_kuka_prc,
    KUKAPrcRobot=kuka_agilus_kr6_kr10_r900,
    LINstartspeed=0.1,
    PRC_SaveNameExpose=False,
    PTPstartspeed=5,
    acc_cp=nan,
    acc_ptp=-1,
    basea=0,
    baseb=0,
    basec=0,
    baseindex=0,
    basex=0,
    basey=0,
    basez=0,
    camrobformatting="""&ACCESS RVP
&REL 1
&PARAM TEMPLATE = C:\KRC\Roboter\Template\vorgabe
&PARAM EDITMASK = *
[PROJECTNAME]

[SPLITDEFS]

;FOLD INI
;FOLD BASISTECH INI
GLOBAL INTERRUPT DECL 3 WHEN $STOPMESS==TRUE DO IR_STOPM ( )
INTERRUPT ON 3
BAS (#INITMOV,0 )
;ENDFOLD (BASISTECH INI)
;ENDFOLD (INI)

[STARTAXPOS]

[SETPARAMETERS]

[COMMANDS]

END""",
    camrobon=False,
    checkallcolls=False,
    enda01=5,
    enda02=-90,
    enda03=100,
    enda04=5,
    enda05=10,
    enda06=-5,
    ende01=0,
    ende02=0,
    ende03=0,
    ende04=0,
    endindex=0,
    haltatend=True,
    hash=11854,
    initialstatus="110",
    int_advance=-1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)  # -> simplify(RobotGeometry), AnalysisOutput

list_item_8 = ListItem(List=kuka_prc_core.RobotGeometry, Index=Slider(8, range=0..9), Wrap=True)

# ==== cluster Cluster
radians = ClusterInput()
degrees = Degrees(Radians=radians)
list_item = ListItem(List=degrees, Index=0, Wrap=True)  # -> Item, Item1, Item2, Item3, Item4, Item5
speed = ClusterInput()
kuka_prc_axis_movement = KUKAPrcAXISMovement(
    Axis1=list_item.Item,
    Axis2=list_item.Item1,
    Axis3=list_item.Item2,
    Axis4=list_item.Item3,
    Axis5=list_item.Item4,
    Axis6=list_item.Item5,
    Speed=speed,
    extaxenabled=False,
    impedancemode=False,
    interpolation="C_PTP")
shift_paths = ShiftPaths(Data=kuka_prc_axis_movement, Offset=-1)
data = ClusterOutput(shift_paths)

# ==== cluster Cluster_2
list = ClusterInput()
list_item = ListItem(List=list, Index=0, Wrap=True)
list_b = ClusterInput()
longest_list = LongestList(ListListA=list_item, ListListB=list_b, PaddingMode=2)  # -> ListListA, ListListB
list_b_2 = ClusterOutput(longest_list.ListListB)
