# Grasshopper definition STABLE_double_tangent_bar_generation.gh (Grasshopper 1.0.7)

point = Point(<point referenced from the Rhino model>)
point_2 = Point(<point referenced from the Rhino model>)
point_3 = Point(<point referenced from the Rhino model>)
point_4 = Point(<point referenced from the Rhino model>)
point_5 = Point(<point referenced from the Rhino model>)
point_6 = Point(<point referenced from the Rhino model>)
point_7 = Point(<point referenced from the Rhino model>)
point_8 = Point(<point referenced from the Rhino model>)
point_9 = Point(<point referenced from the Rhino model>)
point_10 = Point(<point referenced from the Rhino model>)

# ---- group: four tets
point_11 = Point([<point referenced from the Rhino model> x4])

# ----
# caliberated TCP value
# original TCP
# EE visual mesh
# EE visual mesh
# Y moving distance
# connect escape distance after printing
point_12 = Point(<point referenced from the Rhino model>)
merge = Merge(
    Data1=point_11,
    Data2=point_10,
    Data3=point_3,
    Data4=point_7,
    Data5=point_8,
    Data6=point_9,
    Data7=point_4,
    Data8=point_6,
    Data9=point,
    Data10=point_2,
    Data11=point_5,
    Data12=point_12)
merge_2 = Merge(Data1=point_11, Data2=point_10)

# ----
# table model in the origin
brep = Brep(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)

# ----
# Yijiang's 12 bar feasible design
# base tri
point_13 = Point([Point(391.4737498, -36.03747471, -3.651680708), Point(544.4091608, -18.67770667, -3.651680708), Point(452.5567608, 100.9620354, -3.651680708)])
point_14 = Point([Point(391.4737498, -36.03747471, -3.651680708), Point(544.4091608, -18.67770667, -3.651680708), Point(452.5567608, 100.9620354, -3.651680708), Point(445.002397, -26.40318888, 65.68185223), Point(445.0880041, 61.57939256, 80.02722349), Point(503.0356477, 43.28816029, 57.05850849)])

# ---- group: three tets
point_15 = Point([Point(516.5039228, -36.03747471, -3.651680708), Point(669.4393338, -18.67770667, -3.651680708), Point(577.5869338, 100.9620354, -3.651680708), Point(592.8617742, 28.896685, 65.68185223), Point(516.4216173, 42.51219415, 59.94148286), Point(539.0520635, -9.655376275, 87.8988448)])

# ---- group: two tet
# testing design
point_16 = Point([Point(516.5039228, -36.03747471, -3.651680708), Point(669.4393338, -18.67770667, -3.651680708), Point(577.5869338, 100.9620354, -3.651680708), Point(592.8617742, 28.896685, 65.68185223), Point(516.4216173, 42.51219415, 59.94148286)])

# ----
point_17 = Point("600, 0, -14.23")
point_18 = Point(merge_2)
move = Move(Geometry=brep, Motion=point_17)  # -> Geometry, Transform
scale = Scale(Geometry=merge, Center=point_17, Factor=Slider(1, range=1..5))  # -> Geometry, Transform
list_item = ListItem(List=point_18, Index=0, Wrap=True)  # -> Item, Item1, Item2
custom_preview = CustomPreview(Geometry=move.Geometry, Shader=ColourSwatch(SwatchColor=RGB(79, 79, 79)))

# ---- group: base triangle
# Please choose "list_order" if you want
# to use the hand-picked order
point_19 = Point([list_item.Item, list_item.Item1, list_item.Item2])

# ----
point_list = PointList(Points=point_18, Size=Slider(10, range=1..10))
ordering_heuristic = ValueList({"dijkstra", "list_order", "point2triangle_distance", "tet_surface_area", "tet_volume"}, selected="list_order")
search_method = ValueList({"point2point", "point2triangle"}, selected="point2point")
button = Button()
# Not every triple pair has a built triangle!
boolean_toggle = BooleanToggle(False)

# ----
# Shortest Distance
# Method
ghpython_script = GhPythonScript(
    points=point_18,
    base_tri_pts=point_19,
    ordering_heuristic=ordering_heuristic,
    search_method=search_method,
    penalty_cost=Slider(2.9, range=1..10),
    restart=boolean_toggle)  # -> out, simplify(tet_node_ids); inputs points: list of Point3d, base_tri_pts: list of Point3d
# ---------- ghpython_script: Python ----------
from itertools import combinations

import System
import Grasshopper.Kernel.Data.GH_Path as ghpath
import Grasshopper.DataTree as datatree
from ghpythonlib.treehelpers import list_to_tree, tree_to_list

#from compas_ghpython import unload_modules
#unload_modules("coop_assembly")

#from coop_assembly.help_functions import find_point_id, tet_surface_area, \
#    tet_volume, distance_point_triangle
#from coop_assembly.geometry_generation.tet_sequencing import \
#    compute_distance_from_grounded_node
#from coop_assembly.geometry_generation.tet_sequencing import \
#    get_pt2tri_search_heuristic_fn, \
#    point2point_shortest_distance_tet_sequencing, \
#    point2triangle_tet_sequencing

from compas.rpc import Proxy
cp_h = Proxy('coop_assembly.help_functions') #, python='python', capture_output=False)
cp_ts = Proxy('coop_assembly.geometry_generation.tet_sequencing') #, python='python', capture_output=False)
print('rpc address: ', cp_h.address)

if restart:
    cp_h.stop_server()
    cp_h.start_server()
    #
    cp_ts.stop_server()
    cp_ts.start_server()

points = [[p.X, p.Y, p.Z] for p in points]
base_tri_pts = [[p.X, p.Y, p.Z] for p in base_tri_pts]

start_tri_ids = [cp_h.find_point_id(base_pt, points) for base_pt in base_tri_pts]
assert len(start_tri_ids) == 3, 'start triangle should only have three points!'
print('base triangle ids: {}'.format(start_tri_ids))

all_pt_ids = list(range(len(points)))

if search_method == 'point2point':
    cost_from_node = {}
    if ordering_heuristic == 'dijkstra':
        elements = list(combinations(all_pt_ids, 2))
        cost_from_node = cp_ts.compute_distance_from_grounded_node(elements, points, start_tri_ids)
    elif ordering_heuristic == 'list_order':
        for pt_id in all_pt_ids:
            if pt_id in start_tri_ids:
                cost_from_node[pt_id] = 0
            else:
                # just shift by 1 to distinguish index 0 from the grounded ones
                cost_from_node[pt_id] = pt_id
    else:
        raise NotImplementedError('ordering heuristic not implemented!')
        
    print('cost_from_node: {}'.format(cost_from_node))
    
    tet_node_ids = cp_ts.point2point_shortest_distance_tet_sequencing(points, cost_from_node)
     
elif search_method == 'point2triangle':
    heuristic_fn = None
    penalty_cost = penalty_cost or 2.0
    heuristic_fn = cp_ts.get_pt2tri_search_heuristic_fn(points, penalty_cost, ordering_heuristic)
    tet_node_ids = cp_ts.point2triangle_tet_sequencing(\
        points, start_tri_ids, heuristic_fn=heuristic_fn, verbose=True)
else:
    raise NotImplementedError('search method not implemented!')

print tet_node_ids

tet_node_ids = list_to_tree([tet_ids+[pt_id] for tet_ids, pt_id in tet_node_ids], lambda x : x)
# ---------- end ghpython_script ----------

panel = Panel(ghpython_script.out)
rhino_doc_dir = RhinoDocDir()  # -> rhino_doc_dir
# ---------- rhino_doc_dir: Python ----------
import scriptcontext as sc
from os import path

rhino_doc_dir = path.abspath(path.dirname(sc.doc.Path))
# ---------- end rhino_doc_dir ----------

# ---- group: to coop_assembly
integer = Integer(ghpython_script.tet_node_ids)

# ----
panel_2 = Panel("C:\Users\yijiangh\Documents\pb_ws\coop_assembly\tests\test_data")
panel_3 = Panel(rhino_doc_dir)
panel_4 = Panel(integer)
write = BooleanToggle(False)
run = BooleanToggle(True)
ideal_radius = Slider(3.17, range=0.01..10)
pybullet_viewer = BooleanToggle(False)
concatenate = Concatenate(FragmentA=Slider(4, range=1..7), FragmentB="_tets.json")
check_collision = BooleanToggle(True)
correct = BooleanToggle(False)
point_20 = Point(point_18)

boolean_toggle_2 = BooleanToggle(False)  # disabled
ghpython_script_2 = GhPythonScript(viewer=boolean_toggle_2)  # -> out, a; disabled
# ---------- ghpython_script_2: Python ----------
import rhinoscriptsyntax as rs
import Rhino.Geometry.Plane as Plane
import Rhino.Geometry.Point3d as Point3d
import Rhino.Geometry.Vector3d as Vector3d
import Rhino.Geometry.Quaternion as Quat
import Grasshopper.DataTree as DataTree # Add, AddRange(list, GHPath(i, j))
import Grasshopper.Kernel.Data.GH_Path as GHPath
import System

from ghpythonlib.treehelpers import list_to_tree, tree_to_list
import os
#import json
#from compas.geometry import Frame
#from compas_ghpython import draw_pipes, draw_frame

from compas.rpc import Proxy
cp_exe = Proxy('coop_assembly.geometry_generation.execute')

cp_exe.test_connect(viewer) #, capture_output=True
# ---------- end ghpython_script_2 ----------

ghpython_script_3 = PythonScript(
    points=point_20,
    tet_point_ids=integer,
    radius=ideal_radius,
    run=run,
    correct=correct,
    check_collision=check_collision,
    viewer=pybullet_viewer,
    write=write,
    file_dir=panel_3,
    file_name=concatenate)  # -> out, new_ideal_verts, new_ideal_network, bar_vertex_ids, ideal_vertex_ids, bar_end_pts, bar_axis_lines, connector_ids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; inputs points: list of Point3d, tet_point_ids: tree of Int32, base_tri_pts: list of Point3d, check_collision: Boolean
# ---------- ghpython_script_3: Python ----------
import warnings
import System
import Grasshopper.Kernel.Data.GH_Path as ghpath
import Grasshopper.DataTree as datatree
import Rhino.Geometry.Point3d as Point3d
import Rhino.Geometry.Line as Line
from ghpythonlib.treehelpers import tree_to_list, list_to_tree

#from compas.utilities.xfunc import XFunc
#fn = XFunc("coop_assembly.geometry_generation.execute.execute_from_points", python="python")
from compas.rpc import Proxy
cp_exe = Proxy('coop_assembly.geometry_generation.execute')

tet_point_ids = tree_to_list(tet_point_ids, lambda x: x) if tet_point_ids.BranchCount > 1 else [tet_point_ids.Branch(0)]
tet_ids = [[tuple(t_ids[0:3]), t_ids[3]] for t_ids in tet_point_ids]
print('tet_ids: {}'.format(tet_ids))

run = run and not (len(tet_point_ids)==0 or tet_point_ids is None or len(points)==0 or points is None)

points = [(p[0], p[1], p[2]) for p in points]

if run:
    endpts_from_element = cp_exe.execute_from_points(points, tet_ids, radius, correct=correct, check_collision=check_collision, 
        verbose=True, viewer=viewer, \
        write=write, save_dir=file_dir, file_name=file_name)
#    print endpts_from_element
    
    bar_end_pts = datatree[Point3d]()
    bar_axis_lines = datatree[Line]()
    for bar, pts in endpts_from_element.items():
        rpts = [Point3d(*p) for p in pts]
        bar_end_pts.AddRange(rpts, ghpath(int(bar)))
        bar_axis_lines.Add(Line(*rpts), ghpath(int(bar)))
# ---------- end ghpython_script_3 ----------
panel_5 = Panel(ghpython_script_3.out)
curve = Curve(ghpython_script_3.bar_axis_lines)
collision_radius = Slider(2.5, range=0.01..10)
visualize_bar = ValueList({"no-show": 0, "tet-group": 1, "bar-one-by-one": 2, "all": 3}, selected="all")
see_collision_radius = BooleanToggle(False)
stream_filter = StreamFilter(Gate=see_collision_radius, Stream0=ideal_radius, Stream1=collision_radius)
pipe = Pipe(Curve=curve, Radius=stream_filter, Caps=0)  # -> simplify(Pipe)
assembled_bar = ColourSwatch(SwatchColor=RGB(92, 207, 255))
brep_2 = Brep(pipe)
stream_gate = StreamGate(Stream=brep_2, Gate=visualize_bar)  # -> Target0, Target1, Target2, Target3
custom_preview_2 = CustomPreview(Geometry=stream_gate.Target3, Shader=assembled_bar)
end_points = EndPoints(Curve=flatten(curve))  # -> Start, End
point_21 = Point([end_points.Start, end_points.End])
unit_x = UnitX(Factor=Slider(100, range=0..100))
bounding_box = BoundingBox(Content=point_21, Plane=PlaneXY(0, 0, 0), UnionBox=True)  # -> Box, Box_2
point_22 = Point(point_17)
list_length = ListLength(List=flatten(stream_gate.Target3))
deconstruct_box = DeconstructBox(Box=bounding_box.Box)  # -> Plane, X, Y, Z
move_2 = Move(Geometry=point_22, Motion=unit_x)  # -> Geometry, Transform
deconstruct_domain = DeconstructDomain(Domain=deconstruct_box.X)  # -> Start, End
deconstruct_domain_2 = DeconstructDomain(Domain=deconstruct_box.Y)  # -> Start, End
deconstruct_domain_3 = DeconstructDomain(Domain=deconstruct_box.Z)  # -> Start, End
subtraction = Subtraction(A=deconstruct_domain_2.End, B=deconstruct_domain_2.Start)
subtraction_2 = Subtraction(A=deconstruct_domain.End, B=deconstruct_domain.Start)
subtraction_3 = Subtraction(A=deconstruct_domain_3.End, B=deconstruct_domain_3.Start)
integer_2 = Integer(subtraction_2)
integer_3 = Integer(subtraction)
integer_4 = Integer(subtraction_3)
concatenate_2 = Concatenate(Fragment_A="x:", Fragment_B=integer_2, A=", y:", B=integer_3, C=", z:", D=integer_4, E=" (mm)")
concatenate_3 = Concatenate(Fragment_A="Number of bars:", Fragment_B=list_length, B=concatenate_2)
text_tag_3d = TextTag3D(
    Location=move_2.Geometry,
    Text=concatenate_3,
    Size=Slider(7, range=0..10),
    Colour=ColourSwatch(SwatchColor=RGB(0, 0, 0)),
    Justification=7)
